test file "test_req"

suite "Test Requirements Suite for the Pendulum Controller System"
  description: This test suite serves to verify the requirements of the pendulum controller system.

  case "Test Pendulum 1" [simulation]
    model arch_logical, harness arch_logical_Harness_ReqTest
    parameter set "Parameter Set 1": pendulum_type = 1  % model workspace

  case "Test Pendulum 2" [simulation]
    model arch_logical, harness arch_logical_Harness_ReqTest
    parameter set "Parameter Set 1": pendulum_type = 2  % model workspace

  case "Simple Control Test" [simulation] (disabled)
    model arch_logical, harness arch_logical_Harness_ControlTest
    parameter set "Parameter Set 1": pendulum_type = 1  % model workspace